test file "etcTests"
  description: This is a demo test file.
    add.
  setup callback:
    load busData
    controllerData
  coverage: Decision

suite "PWM Conversion"
  setup callback:
    clc
    disp('Running PWM Conversion tests...')
  cleanup callback:
    disp('PWM Conversion tests completed.')

  case "SIL Equivalence Test" [equivalence]
    description: Compares the PWM conversion algorithm in Normal and Software-in-the-Loop (SIL) modes.
    simulation 1:
      model pwmCnv, mode Software-in-the-Loop (SIL)
      input "pwmTestData.mat", mapped to controller_output (active)
    simulation 2:
      model pwmCnv
      input "pwmTestData.mat", mapped to controller_output (active)
    equivalence criteria
      motor_inputs.duty
      motor_inputs.direction
    custom criteria (off):
      % Return value: customCriteria
      % set customCriteria.out to true for pass and false for fail
      % set customCriteria.logs (cell array) for log messages
      % set customCriteria.errors (cell array) for error messages

      customCriteria.out = true;
    iteration script:
      %% Iterate over all External Inputs.

      % Determine the number of possible iterations
      numSteps = length(sltest_externalInputs{1});

      % Create each iteration
      for k = 1 : numSteps
          % Set up a new iteration object
          testItr = sltestiteration();

          % Set iteration settings
          setTestParam(testItr, 'ExternalInput', sltest_externalInputs{1}{k}, 'Simulation', 1);

          % Register the iteration to run in this test case
          addIteration(sltest_testCase, testItr); % You can pass in an optional iteration name
      end

  case "Zero Input Test" [simulation]
    description: Simulation test that passes zero input into the PWM model. The test data was automatically generated using Simulink Design Verifier's test generation.
    model pwmCnv
    input "Test Case:1" from pwmCnv_sldvdata.mat (active)
    input "Design Verifier (pwmCnv_sldvdata.mat)" from pwmCnv_sldvdata.mat

suite "PI Controller"
  setup callback:
    disp('Running PI Controller tests...')
  cleanup callback:
    disp('PI Controller tests completed.')

  case "Windup Test" [simulation]
    description: Simulate the PI controller model to test for integrator windup.
    model piCtrl, harness piCtrl_Logic
    custom criteria (off): same code as in custom criteria (off) of case "SIL Equivalence Test"

  case "Parameter Tunability Test" [baseline]
    description: Simulate the PI controller model with parameter overrides and compare it to expected outputs.
    model piCtrl, harness piCtrl_Harness
    parameter set "Parameter Set 1": Ki = 1, Kp = 0.5  % base workspace
    baseline "piExpectedOutput1.mat": abs tol 0.01, rel tol 0.05
      pedal_scaled
      angle_scaled
      controller_output
    baseline "piExpectedOutput2.mat": abs tol 0.01, rel tol 0.05
      pedal_scaled
      angle_scaled
      controller_output
    iterations:
      Iteration1: SignalBuilderGroup "PI Test 1", Baseline "piExpectedOutput1.mat"
      Iteration2: SignalBuilderGroup "PI Test 2", Baseline "piExpectedOutput2.mat"