% Requirement links of etcTests.mldatx (R2020b)

item 1 verifies throttleReqs.doc#@pi_ctrl_3: pi_ctrl_3: Maximum value of integral state ...
item 2 verifies throttleReqs.slreqx#30: pwm_5: Normal simulation and software-i...
item 3 verifies throttleReqs.slreqx#7: pi_ctrl_2: Proportional and integral gains ...